# Dynamo graph 01-Duct _Support.dyn (Dynamo 2.0.3.8810)

family_types = FamilyTypes(index=281)  # graph input
select_model_elements = DSModelElementsSelection()  # 1 picked in the model; graph input
getLocation = Element.GetLocation(element=select_model_elements)
length = Curve.Length(curve=getLocation)
code_block = CodeBlock(x=length) { x>200; }
code_block_2 = CodeBlock { true; }
allIndicesOf = List.AllIndicesOf(list=code_block, item=code_block_2)
getItemAtIndex = List.GetItemAtIndex(list=select_model_elements, index=allIndicesOf)
getLocation_2 = Element.GetLocation(element=getItemAtIndex)
code_block_3 = CodeBlock(x=getLocation_2) { (x.StartPoint).Z; (x.EndPoint).Z; }
code_block_4 = CodeBlock(R=code_block_3.out0, M=code_block_3.out1) { R-M; }
abs = Math.Abs(number=code_block_4)
code_block_5 = CodeBlock(x=abs) { x<1; true; }
allIndicesOf_2 = List.AllIndicesOf(list=code_block_5.out0, item=code_block_5.out1)
getItemAtIndex_2 = List.GetItemAtIndex(list=getItemAtIndex, index=allIndicesOf_2)
getLocation_3 = Element.GetLocation(element=getItemAtIndex_2)
length_2 = Curve.Length(curve=getLocation_3)
code_block_6 = CodeBlock(X=length_2) { X>2000; }
code_block_7 = CodeBlock(x=length_2) { 200..x..2000; }
pointAtSegmentLength = Curve.PointAtSegmentLength(curve=getLocation_3, segmentLength=code_block_7)
code_block_8 = CodeBlock { 0.5; }
pointAtParameter = Curve.PointAtParameter(curve=getLocation_3, param=code_block_8)
formula = Formula("iF(X=true,r,m)", x=code_block_6, r=pointAtSegmentLength, m=pointAtParameter, lacing=Shortest)
bottom_level = Levels(index=1)  # graph input
byPointAndLevel = FamilyInstance.ByPointAndLevel(familyType=family_types, point=formula, level=bottom_level)
direction = Line.Direction(line=getLocation_3)
YAxis = Vector.YAxis()
angleWithVector = Vector.AngleWithVector(vector=direction, otherVector=YAxis)
count = List.Count(list=formula@L2)
ofRepeatedItem = List.OfRepeatedItem(item=angleWithVector, amount=count, lacing=Shortest)
setRotation = FamilyInstance.SetRotation(familyInstance=byPointAndLevel, degree=ofRepeatedItem)
code_block_9 = CodeBlock { "Offset"; 0; }
setParameterByName = Element.SetParameterByName(element=setRotation, parameterName=code_block_9.out0, value=code_block_9.out1)
code_block_10 = CodeBlock { "Support Legth"; }
code_block_11 = CodeBlock(x=getItemAtIndex_2) { x; }
code_block_12 = CodeBlock { "Width"; }
getParameterValueByName = Element.GetParameterValueByName(element=code_block_11, parameterName=code_block_12)
code_block_13 = CodeBlock { "Insulation Thickness"; }
getParameterValueByName_2 = Element.GetParameterValueByName(element=code_block_11, parameterName=code_block_13)
code_block_14 = CodeBlock(R=getParameterValueByName, M=getParameterValueByName_2) { R+(2*M)+90; }
ofRepeatedItem_2 = List.OfRepeatedItem(item=code_block_14, amount=count, lacing=Shortest)
setParameterByName_2 = Element.SetParameterByName(element=setParameterByName, parameterName=code_block_10, value=ofRepeatedItem_2)
code_block_15 = CodeBlock { "Floor Height"; }
top_level = Levels(index=2)  # graph input
elevation = Level.Elevation(level=top_level)
elevation_2 = Level.Elevation(level=bottom_level)
code_block_16 = CodeBlock(R=elevation, M=elevation_2) { R-M; }
setParameterByName_3 = Element.SetParameterByName(element=setParameterByName_2, parameterName=code_block_15, value=code_block_16)
code_block_17 = CodeBlock { "Duct Height"; }
code_block_18 = CodeBlock { "Height"; }
getParameterValueByName_3 = Element.GetParameterValueByName(element=code_block_11, parameterName=code_block_18)
code_block_19 = CodeBlock(x=getParameterValueByName_3) { x+5; }
ofRepeatedItem_3 = List.OfRepeatedItem(item=code_block_19, amount=count, lacing=Shortest)
setParameterByName_4 = Element.SetParameterByName(element=setParameterByName_3, parameterName=code_block_17, value=ofRepeatedItem_3)
code_block_20 = CodeBlock { "Duct Offset"; }
code_block_21 = CodeBlock { "Offset"; }
getParameterValueByName_4 = Element.GetParameterValueByName(element=code_block_11, parameterName=code_block_21)
ofRepeatedItem_4 = List.OfRepeatedItem(item=getParameterValueByName_4, amount=count, lacing=Shortest)
setParameterByName_5 = Element.SetParameterByName(element=setParameterByName_4, parameterName=code_block_20, value=ofRepeatedItem_4)
