# Dynamo graph 01-Fire_Pipe_Support_Workshop.dyn (Dynamo 2.0.3.8810)

select_model_elements = DSModelElementsSelection()  # 559 picked in the model

# group: PIPE LENGTH > 200
getLocation = Element.GetLocation(element=select_model_elements)
length = Curve.Length(curve=getLocation)
code_block = CodeBlock(x=length) { x>200; }
code_block_2 = CodeBlock { true; }
allIndicesOf = List.AllIndicesOf(list=code_block, item=code_block_2)
getItemAtIndex = List.GetItemAtIndex(list=select_model_elements, index=allIndicesOf)

# group: PIPES SHOULD BE HORIZONTAL
getLocation_2 = Element.GetLocation(element=getItemAtIndex)
code_block_3 = CodeBlock(x=getLocation_2) { DSCore.Math.Abs(((x.StartPoint).Z)-((x.EndPoint).Z)); }
code_block_4 = CodeBlock(x=code_block_3) { x<200; }
code_block_5 = CodeBlock { true; }
allIndicesOf_2 = List.AllIndicesOf(list=code_block_4, item=code_block_5)

getItemAtIndex_2 = List.GetItemAtIndex(list=getItemAtIndex, index=allIndicesOf_2)

# group: FILTER ACCORDING TO DIAMETER
code_block_6 = CodeBlock { "Diameter"; }
getParameterValueByName = Element.GetParameterValueByName(element=getItemAtIndex_2, parameterName=code_block_6)
code_block_7 = CodeBlock(X=getParameterValueByName) { X<40; }
filterByBoolMask = List.FilterByBoolMask(list=getItemAtIndex_2, mask=code_block_7)

# group: SUPPORT PLACEMENT
getLocation_3 = Element.GetLocation(element=filterByBoolMask.in)
length_2 = Curve.Length(curve=getLocation_3)
code_block_8 = CodeBlock(x=length_2) { 1500..x..4650; }
getLocation_4 = Element.GetLocation(element=filterByBoolMask.out)
length_3 = Curve.Length(curve=getLocation_4)
code_block_9 = CodeBlock(x=length_3) { 200..x..4000; }
pointAtSegmentLength = Curve.PointAtSegmentLength(curve=getLocation_4, segmentLength=code_block_9)

python_script = Python(IN[0]=code_block_8)
# ---------- python_script.python (13 lines) ----------
# Enable Python support and load DesignScript library
import clr
clr.AddReference('ProtoGeometry')
from Autodesk.DesignScript.Geometry import *

# The inputs to this node will be stored as a list in the IN variables.
input = IN[0]


# Place your code below this line

# Assign your output to the OUT variable.
OUT = filter(None, input)
# ----------------------------------------

# group (continued): SUPPORT PLACEMENT
pointAtSegmentLength_2 = Curve.PointAtSegmentLength(curve=getLocation_3, segmentLength=python_script)

list_create = List.Create(item0=pointAtSegmentLength_2, item1=pointAtSegmentLength)
flatten = List.Flatten(list=list_create)
code_block_10 = CodeBlock { "FRS-PIPE ACCESSORIES-SUPPORT-RING"; }
byName = Family.ByName(name=code_block_10)
code_block_11 = CodeBlock(x=filterByBoolMask.out) { x; }
code_block_12 = CodeBlock { "Size"; }
getParameterValueByName_2 = Element.GetParameterValueByName(element=code_block_11, parameterName=code_block_12)
code_block_13 = CodeBlock { "FRS-PIPE ACCESSORIES-FIRE PIPE SUPPORT"; }
python_string_concatinating = Python(IN[0]=getParameterValueByName_2, IN[1]=code_block_13)
# ---------- python_string_concatinating.python (21 lines) ----------
# Enable Python support and load DesignScript library
import clr
clr.AddReference('ProtoGeometry')
from Autodesk.DesignScript.Geometry import *

# The inputs to this node will be stored as a list in the IN variables.
x = IN[0]
y = IN[1]
sizes = []

# Place your code below this line
count = 0
for i in  x:
	if count < len(x):
		count = count + 1
		z = y + "-" + str(i) + " " + "mm"
	
		sizes.insert(count, z)
		
# Assign your output to the OUT variable.
OUT = sizes
# ----------------------------------------
byFamilyAndName = FamilyType.ByFamilyAndName(family=byName, name=python_string_concatinating)
bottom_level = Levels(index=5)
byPointAndLevel = FamilyInstance.ByPointAndLevel(familyType=byFamilyAndName, point=pointAtSegmentLength, level=bottom_level)
direction = Line.Direction(line=getLocation_4)
YAxis = Vector.YAxis()
angleWithVector = Vector.AngleWithVector(vector=direction, otherVector=YAxis)
setRotation = FamilyInstance.SetRotation(familyInstance=byPointAndLevel, degree=angleWithVector)
code_block_14 = CodeBlock { "Offset"; }
code_block_15 = CodeBlock { 0; }
setParameterByName = Element.SetParameterByName(element=setRotation, parameterName=code_block_14, value=code_block_15)
code_block_16 = CodeBlock { "Pipe Offset"; }
code_block_17 = CodeBlock { "Offset"; }
getParameterValueByName_3 = Element.GetParameterValueByName(element=code_block_11, parameterName=code_block_17)
setParameterByName_2 = Element.SetParameterByName(element=setRotation, parameterName=code_block_16, value=getParameterValueByName_3)
code_block_18 = CodeBlock { "Floor Height"; }
top_level = Levels(index=6)
elevation = Level.Elevation(level=top_level)
elevation_2 = Level.Elevation(level=bottom_level)
code_block_19 = CodeBlock(R=elevation, M=elevation_2) { R-M; }
setParameterByName_3 = Element.SetParameterByName(element=setRotation, parameterName=code_block_18, value=code_block_19)
code_block_20 = CodeBlock(x=filterByBoolMask.in) { x; }
code_block_21 = CodeBlock { "Size"; }
getParameterValueByName_4 = Element.GetParameterValueByName(element=code_block_20, parameterName=code_block_21)
python_string_concatinating_2 = Python(IN[0]=getParameterValueByName_4, IN[1]=code_block_13)
# ---------- python_string_concatinating_2.python (21 lines) ----------
# Enable Python support and load DesignScript library
import clr
clr.AddReference('ProtoGeometry')
from Autodesk.DesignScript.Geometry import *

# The inputs to this node will be stored as a list in the IN variables.
x = IN[0]
y = IN[1]
sizes = []

# Place your code below this line
count = 0
for i in  x:
	if count < len(x):
		count = count + 1
		z = y + "-" + str(i) + " " +"mm"
	
		sizes.insert(count, z)
		
# Assign your output to the OUT variable.
OUT = sizes
# ----------------------------------------
byFamilyAndName_2 = FamilyType.ByFamilyAndName(family=byName, name=python_string_concatinating_2)
byPointAndLevel_2 = FamilyInstance.ByPointAndLevel(familyType=byFamilyAndName_2, point=pointAtSegmentLength_2, level=bottom_level)
direction_2 = Line.Direction(line=getLocation_3)
YAxis_2 = Vector.YAxis()
angleWithVector_2 = Vector.AngleWithVector(vector=direction_2, otherVector=YAxis_2)
setRotation_2 = FamilyInstance.SetRotation(familyInstance=byPointAndLevel_2, degree=angleWithVector_2)
code_block_22 = CodeBlock { "Offset"; }
code_block_23 = CodeBlock { 0; }
setParameterByName_4 = Element.SetParameterByName(element=setRotation_2, parameterName=code_block_22, value=code_block_23)
code_block_24 = CodeBlock { "Pipe Offset"; }
code_block_25 = CodeBlock { "Offset"; }
getParameterValueByName_5 = Element.GetParameterValueByName(element=code_block_20, parameterName=code_block_25)
setParameterByName_5 = Element.SetParameterByName(element=setRotation_2, parameterName=code_block_24, value=getParameterValueByName_5)
code_block_26 = CodeBlock { "Floor Height"; }
setParameterByName_6 = Element.SetParameterByName(element=setRotation_2, parameterName=code_block_26, value=code_block_19)
