# Dynamo graph duct_support 2.dyn "duct" (Dynamo 2.0.3.8810)

python_script = Python()  # unwired: IN[0]
# ---------- python_script.python (16 lines) ----------
# Enable Python support and load DesignScript library
import clr
clr.AddReference('ProtoGeometry')
from Autodesk.DesignScript.Geometry import *

# The inputs to this node will be stored as a list in the IN variables.
x = IN[]
y = 0
r = []
# Place your code below this line
for i in range(0,len[x]):
	y = abs( (x[i].StartPoint).Z - (x[i].EndPoint).Z )
	r.append(y)

# Assign your output to the OUT variable.
OUT = r
# ----------------------------------------
watch = Watch(python_script)
select_model_elements = DSModelElementsSelection()  # 12 picked in the model
watch_2 = Watch(select_model_elements)
family_types = FamilyTypes(index=266)
getLocation = Element.GetLocation(element=select_model_elements)
length = Curve.Length(curve=getLocation)
code_block = CodeBlock(x=length) { x>200; }
code_block_2 = CodeBlock { true; }
allIndicesOf = List.AllIndicesOf(list=code_block, item=code_block_2)
getItemAtIndex = List.GetItemAtIndex(list=select_model_elements, index=allIndicesOf)
getLocation_2 = Element.GetLocation(element=getItemAtIndex)
code_block_3 = CodeBlock(x=getLocation_2) { (x.StartPoint).Z-(x.EndPoint).Z; }
abs = Math.Abs(number=code_block_3)
code_block_4 = CodeBlock(x=abs) { x<1; }
code_block_5 = CodeBlock { true; }
allIndicesOf_2 = List.AllIndicesOf(list=code_block_4, item=code_block_5)
getItemAtIndex_2 = List.GetItemAtIndex(list=getItemAtIndex, index=allIndicesOf_2)
getLocation_3 = Element.GetLocation(element=getItemAtIndex_2)
length_2 = Curve.Length(curve=getLocation_3, lacing=Shortest)
code_block_6 = CodeBlock(x=length_2) { x>2000; }
code_block_7 = CodeBlock(x=length_2) { 200..x..2000; }
pointAtSegmentLength = Curve.PointAtSegmentLength(curve=getLocation_3, segmentLength=code_block_7)
code_block_8 = CodeBlock { 0.5; }
pointAtParameter = Curve.PointAtParameter(curve=getLocation_3, param=code_block_8)
if_ = If(test=code_block_6, true=pointAtSegmentLength, false=pointAtParameter)
bottom = Levels(index=1)
byPointAndLevel = FamilyInstance.ByPointAndLevel(familyType=family_types, point=if_, level=bottom)
direction = Line.Direction(line=getLocation_3)
YAxis = Vector.YAxis()
angleWithVector = Vector.AngleWithVector(vector=direction, otherVector=YAxis)
setRotation = FamilyInstance.SetRotation(familyInstance=byPointAndLevel, degree=angleWithVector)
code_block_9 = CodeBlock { "Duct Offset"; }
code_block_10 = CodeBlock(x=getItemAtIndex_2) { x; }
code_block_11 = CodeBlock { "Offset"; }
getParameterValueByName = Element.GetParameterValueByName(element=code_block_10, parameterName=code_block_11)
setParameterByName = Element.SetParameterByName(element=setRotation, parameterName=code_block_9, value=getParameterValueByName)
code_block_12 = CodeBlock { "Support Legth"; }
code_block_13 = CodeBlock { "Insulation Thickness"; }
getParameterValueByName_2 = Element.GetParameterValueByName(element=code_block_10, parameterName=code_block_13)
code_block_14 = CodeBlock { "Width"; }
getParameterValueByName_3 = Element.GetParameterValueByName(element=code_block_10, parameterName=code_block_14)
code_block_15 = CodeBlock(R=getParameterValueByName_2, M=getParameterValueByName_3) { R+(M+160); }
setParameterByName_2 = Element.SetParameterByName(element=setRotation, parameterName=code_block_12, value=code_block_15)
code_block_16 = CodeBlock { "Floor Height"; }
top = Levels(index=2)
elevation = Level.Elevation(level=top)
code_block_17 = CodeBlock(T=elevation) { T-500; }
setParameterByName_3 = Element.SetParameterByName(element=setRotation, parameterName=code_block_16, value=code_block_17)
code_block_18 = CodeBlock { "Duct Height"; }
code_block_19 = CodeBlock { "Height"; }
getParameterValueByName_4 = Element.GetParameterValueByName(element=code_block_10, parameterName=code_block_19)
code_block_20 = CodeBlock(x=getParameterValueByName_4) { x+55; }
setParameterByName_4 = Element.SetParameterByName(element=setRotation, parameterName=code_block_18, value=code_block_20)
elevation_2 = Level.Elevation(level=bottom)
code_block_21 = CodeBlock { "Offset"; }
code_block_22 = CodeBlock { 0; }
setParameterByName_5 = Element.SetParameterByName(element=setRotation, parameterName=code_block_21, value=code_block_22)
